# Dynamo graph Получение сведений о проекте.dyn (Dynamo 2.6.1.8786)

file_path = Filename("D:\05_Эксперименты\20230829_IFC_РедактированиеПараметровPython\102-2022-01-АР-REV21_ProjectParams.csv")
code_block = CodeBlock { "OST_ProjectInformation"; }
code_block_2 = CodeBlock(cat=code_block) { Revit.Elements.Category.ByName(cat); }
all_elements_of_category = ElementsOfCategory(Category=code_block_2)
parameters = Element.Parameters(element=all_elements_of_category)
flatten = List.Flatten(list=parameters)
exportCSV = Data.ExportCSV(filePath=file_path, data=flatten)
